# Grasshopper definition Canopy Divs.gh (Grasshopper 1.0.7)

number_slider = Slider(10, range=0..10)
u_divisions = GetInteger(Slider(13, range=1..40), AtLeast=1, AtMost=1, Maximum=100, Minimum=2, Prompt="U Divisions (2 to 100)")
v_divisions = GetInteger(Slider(15, range=1..40), AtLeast=1, AtMost=1, Maximum=100, Minimum=2, Prompt="V Divisions (2 to 100)")
canopy_depth = GetNumber(
    Slider(2, range=1..5),
    AtLeast=1,
    AtMost=1,
    Maximum=1.797693135e+308,
    Minimum=-1.797693135e+308,
    Prompt="Input Canopy Depth")
pt = Point([Point(2.960074945, -112.1066639, 0), Point(86.7842717, -141.9970222, 0), Point(223.8814752, -3.351551851, 0), Point(-8.447499552, 5.721152517, 0)])
Z = UnitZ(Factor=number_slider)
move = Move(Geometry=pt, Motion=Z)  # -> graft(Geometry), Transform
cyl = Cylinder(Base=pt, Radius=Slider(2, range=0..10), Length=number_slider)
cap = CapHoles(Brep=cyl)
bang = ExplodeTree(Data=move.Geometry)  # -> Branch0, Branch1, Branch2, Branch3
srf4pt = _4PointSurface(CornerA=bang.Branch0, CornerB=bang.Branch1, CornerC=bang.Branch2, CornerD=bang.Branch3)  # -> reparameterize(Surface)
divide = DivideDomain²(Domain=srf4pt, UCount=u_divisions, VCount=v_divisions)
subsrf = Isotrim(Surface=srf4pt, Domain=divide)
debrep = DeconstructBrep(Brep=subsrf)  # -> Faces, Edges, Vertices
flip = FlipMatrix(Data=debrep.Vertices)
bang_2 = ExplodeTree(Data=simplify(flip))  # -> Branch0, Branch1, Branch2, Branch3
ln = Line(StartPoint=bang_2.Branch0, EndPoint=bang_2.Branch2)
ln_2 = Line(StartPoint=bang_2.Branch1, EndPoint=bang_2.Branch3)
join = JoinCurves(Curves=[ln_2, ln], Preserve=False)
cp = ControlPoints(Curve=join)  # -> Points, Weights, Knots
mesh = MeshBrep(
    Brep=cap,
    Settings={GridMaxCount=0, GridMinCount=16, JaggedSeams=False, MaxEdgeLength=0, MinEdgeLength=0.0001, MinTolerance=0, Refine=True, RefineAngle=0, RelativeTolerance=0.65, SimplePlanes=True, Tolerance=0})
prune = PruneTree(Tree=cp.Points, Minimum="4", Maximum=0)
medges = MeshEdges(Mesh=mesh)  # -> NakedEdges, InteriorEdges, NonManifoldEdges
intcrv = Interpolate(Vertices=prune, Degree=3, Periodic=False, KnotStyle=1)  # -> Curve, Length, Domain
Z_2 = UnitZ(Factor=canopy_depth)
crv = Curve([medges.NakedEdges, medges.InteriorEdges, medges.NonManifoldEdges])
extr = Extrude(Base=intcrv.Curve, Direction=Z_2)
context_bake = ContextBake(Geometry=crv)
mesh_2 = MeshBrep(
    Brep=extr,
    Settings={GridMaxCount=0, GridMinCount=16, JaggedSeams=False, MaxEdgeLength=0, MinEdgeLength=0.0001, MinTolerance=0, Refine=True, RefineAngle=0, RelativeTolerance=0.65, SimplePlanes=True, Tolerance=0})
medges_2 = MeshEdges(Mesh=mesh_2)  # -> NakedEdges, InteriorEdges, NonManifoldEdges
join_2 = JoinCurves(Curves=medges_2.NakedEdges, Preserve=False)
join_3 = JoinCurves(Curves=medges_2.InteriorEdges, Preserve=False)
merge = Merge(Data1=join_2, Data2=join_3)  # -> flatten(Result)
curvepoint = PointOnCurve(merge, parameter=0.502)
pt_2 = ConstructPoint(XCoordinate=0, YCoordinate=0, ZCoordinate=0)
pull = PullPoint(Point=curvepoint, Geometry=pt_2, ClosestOnly=True)  # -> ClosestPoint, Distance
bnd = Bounds(Numbers=pull.Distance)
remap = RemapNumbers(Value=pull.Distance, Source=bnd, Target=Domain(0, 1))  # -> Mapped, Clipped
gradient = Gradient(
    LowerLimit=0,
    UpperLimit=1,
    Parameter=remap.Mapped,
    stops=[0: RGB(0, 34, 255), 0.498: RGB(255, 0, 255), 1: RGB(0, 255, 0)])
c_script = CSharpScript(crv=merge, color=gradient)  # -> out, A; inputs crv: Curve, color: Color
# ---------- c_script: C# ----------
    var c = color.R + "," + color.G + "," + color.B;
    crv.SetUserString("color", c);
    A = crv;
# ---------- end c_script ----------
crv_2 = Curve(c_script.A)
context_bake_2 = ContextBake(Geometry=crv_2)
